# Grasshopper definition topology_net.gh (Grasshopper 0.9.76)
# Copyright: Co-de-iT

panel = Panel("curves network")
# Topology net
# 
# Export a net topology from lines towards Processing
# 
# code by Alessio Erioli
# 
# © a3 2017 _ Creative Commons Attribution-NonCommercial-ShareAlike3.0 UnportedLicense.
crv = Curve([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])
preview = CustomPreview(
    Geometry=crv,
    Shader={ambient=RGB(0, 0, 0), diffuse=RGB(255, 105, 180), emission=RGB(76, 32, 54), shine=0.5, specular=RGB(255, 255, 255), transparency=0})

end = EndPoints(Curve=crv)  # -> Start, End
merge = Merge(Data1=end.Start, Data2=end.End)  # -> flatten(Result)
cset = CreateSet(List=merge)  # -> Set, Map
type = Panel("1")
mindex = MemberIndex(Set=cset.Set, Member=end.Start)  # -> Index, Count
mindex_2 = MemberIndex(Set=cset.Set, Member=end.End)  # -> Index, Count
expression = Expression(P=cset.Set, type=type, Expression="Format(\"{0},{1},{2},{3}\",P.x,P.y,P.z,type)")
expression_2 = Expression(x=mindex.Index, y=mindex_2.Index, Expression="Format(\"{0},{1}\",int(x), int(y))")  # -> flatten(R)

# ----
# create topology map
item = ListItem(List=cset.Set, Index=mindex.Index, Wrap=True)
item_2 = ListItem(List=cset.Set, Index=mindex_2.Index, Wrap=True)
lng = ListLength(List=cset.Set)
avr = Average(Input=[item, item_2])  # -> flatten(ArithmeticMean)
series = Series(Start=0, Step=1, Count=lng)
int = Integer(series)
unique_points = Panel(expression)
connections = Panel(expression_2)
# point tags
tag = TextTag3D(
    Location=cset.Set,
    Text=int,
    Size=Slider(3.201, range=0..5),
    Colour=ColourSwatch(SwatchColor=RGB(255, 255, 255)),
    Justification=7)
# connection tags
tag_2 = TextTag3D(
    Location=avr,
    Text=expression_2,
    Size=Slider(2, range=0..5),
    Colour=ColourSwatch(SwatchColor=RGB(8, 8, 8)),
    Justification=7)

dir_type = ValueList({"desktop": 0, "documents": 1, "GH file path": 2, "C:": 3}, selected="GH file path")
custom_subdir = Panel("data")
dir = CSharpScript(type=dir_type, dir=custom_subdir)  # -> out, A; inputs type: Int32, dir: String
# ---------- dir: C# ----------
    String S = "";
    String root = "";
    String end = "\\";
    switch(type){
      case 0:
        root = Environment.GetFolderPath(Environment.SpecialFolder.Desktop);
        S = "Desktop";
        break;
      case 1:
        root = Environment.GetFolderPath(Environment.SpecialFolder.MyDocuments);
        S = "Documents";
        break;
      case 2:
        GH_Document gh_d = owner.OnPingDocument();

        if (gh_d.IsFilePathDefined)
        {          
          //root = gh_d.FilePath; // this includes the filename, which we don't want
          root = (System.IO.Path.GetDirectoryName(GrasshopperDocument.FilePath));
          S = "GH File path";
        }
        else
        {
          Print("No path defined. Saving to Desktop until then");
          root = Environment.GetFolderPath(Environment.SpecialFolder.Desktop);
          S = "Desktop";
        }
        break;
      case 3:
        root = "C:";
        S = root + end;
        break;
    }
    A = root + end + (dir != null ? (dir + end) : "");
    Component.Message = S;
# ---------- end dir ----------
destination_directory = Panel(dir.A)

file_name_extension = Panel("connections.txt")
file_name_extension_2 = Panel("points.txt")
save = Button()
# export topology map as text files
save_2 = Button()
savetofile = SaveToFile(S=connections, dir=destination_directory, file=file_name_extension, save=save_2)  # -> out; inputs S: list of String, dir: String, file: String, save: Boolean
# ---------- savetofile: C# ----------
    String eol = Environment.NewLine;
    Component.Message = "write to file";
    Component.Name = "Save to File";
    Component.NickName = "SaveToFile";
    Component.Description = "Saves a text sequence to a file";

    if (save){
      if (!Directory.Exists(dir)) Directory.CreateDirectory(dir);

      String target = dir + file;

        System.IO.File.WriteAllLines(target, S.ToArray());
        Print("file saved as: " + target);
    } else {
      Print("press save button to save pdl file");
    }
# ---------- end savetofile ----------
savetofile_2 = SaveToFile(S=unique_points, dir=destination_directory, file=file_name_extension_2, save=save)  # -> out; inputs S: list of String, dir: String, file: String, save: Boolean; same code as savetofile
