# Grasshopper definition 170216_strain pattern.gh (Grasshopper 0.9.76)
# plug-ins: Volvox, Human, Kangaroo Components, Kangaroo2 Components

number_slider = Slider(3000, range=0..3000)  # disabled
crv = Curve(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)  # disabled
boundary = BoundarySurfaces(Edges=crv)  # disabled
popgeo = PopulateGeometry(Geometry=boundary, Count=number_slider, Seed=1)  # disabled
number_slider_2 = Slider(22, range=0..100)  # disabled
con = DelaunayEdges(Points=popgeo, Plane=PlaneXY(0, 0, 0))  # -> Connectivity, Edges; disabled
len = Length(Curve=con.Edges)  # disabled
smaller = SmallerThan(FirstNumber=len, SecondNumber=number_slider_2)  # -> SmallerThan, OrEqualTo; disabled
dispatch = Dispatch(List=con.Edges, DispatchPattern=smaller.SmallerThan)  # -> ListA, ListB; disabled
crv_2 = Curve(dispatch.ListA)  # disabled

# ---- group: connection indices
int = Integer(Tree({0}: [1, 2, 3, 4, 5, 6, 7, 8], {1}: [0, 1952, 2301, 1954, 3, 7, 2305], {2}: [0, 2047, 2048, 2051, 5, 6], {3}: [0, 2301, 1, 2302, 8], {4}: [0, 2856, 5, 7, 2858], {5}: [0, 2856, 2, 4, 2051]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))

# ---- group: lines
crv_3 = Curve([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])

# ---- group: points
pt = Point([Point(-582.9947902, 219.5585181, 0), Point(-584.1701461, 212.0741414, 0), Point(-580.151449, 224.911257, 0), Point(-588.392935, 216.3705588, 0), Point(-578.5899108, 217.8620453, 0), Point(-578.244276, 221.5923393, 0)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])

# ----
crv_4 = Curve(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)
crv_5 = Curve(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)
incurves = PointInCurves(Point=pt, Curves=crv_5)  # -> Relationship, Index, Point
incurves_2 = PointInCurves(Point=pt, Curves=crv_4)  # -> Relationship, Index, Point
dispatch_2 = Dispatch(List=pt, DispatchPattern=incurves.Relationship)  # -> ListA, ListB
dispatch_3 = Dispatch(List=pt, DispatchPattern=incurves_2.Relationship)  # -> ListA, ListB
crv_6 = Curve(crv_3)

# ---- group: another way of building lines
item = ListItem(List=pt, Index=int, Wrap=True)
ln = Line(StartPoint=graft(pt), EndPoint=item)  # -> flatten(Line)

# ---- group: SUPPORTS
suppports = Point(dispatch_2.ListA)

# ---- group: LOADS
suppports_2 = Point(dispatch_3.ListA)

# ----
dupln = RemoveDuplicateLines(Lines=crv_6, Tolerance=0.01)
Y = UnitY(Factor=Slider(20, range=0..220))
len_2 = Length(Curve=dupln)
neg = Negative(Value=Y)

length_line = LengthLine(Line=dupln, Length=len_2, Strength=Slider(300, range=0..2100))
anchor = Anchor(Point=suppports, Strength=1000)
load = Load(Point=suppports_2, ForceVector=neg)

reset = Button()
on = BooleanToggle(False)
solver = Solver(GoalObjects=[anchor, length_line, load], Reset=reset, Threshold=1e-15, Tolerance=0.01, On=on)  # -> I, V, O
clean = CleanTree(RemoveNulls=True, RemoveInvalid=True, RemoveEmpty=False, Tree=solver.O)
len_3 = Length(Curve=clean)
len_4 = Length(Curve=dupln)
subtraction = Subtraction(A=len_3, B=len_4)
division = Division(A=subtraction, B=len_4)
abs = Absolute(Value=division)
number_slider_3 = Slider(0.05, range=0..0.1)
bnd = Bounds(Numbers=abs)
remap = RemapNumbers(Value=abs, Source=bnd, Target="1 to 5")  # -> Mapped, Clipped
dedomain = DeconstructDomain(Domain=bnd)  # -> Start, End
neg_2 = Negative(Value=number_slider_3)
bar_graph = BarGraph(division, BarColor=RGB(255, 0, 90))
gradient = Gradient(
    LowerLimit=neg_2,
    UpperLimit=number_slider_3,
    Parameter=subtraction,
    stops=[0.292: RGB(0, 255, 160), 0.474: RGB(21, 0, 0), 0.638: RGB(220, 0, 40)])
gradient_2 = Gradient(LowerLimit=neg_2, UpperLimit=number_slider_3, Parameter=subtraction, stops=[0.463: RGB(0, 0, 0), 1: RGB(255, 255, 255)])
gradient_3 = Gradient(LowerLimit=dedomain.Start, UpperLimit=dedomain.End, Parameter=abs, stops=[0: RGB(255, 255, 255), 0.0857: RGB(255, 0, 0)])
curvepoint = PointOnCurve(clean, parameter=0.5)
cloud = ConstructCloud(Points=curvepoint, Colors=gradient_3)
previewlw = CustomPreviewLineweights(Geometry=clean, Shader=gradient_2, Thickness=remap.Mapped, Absolute=False)
previewlw_2 = CustomPreviewLineweights(Geometry=clean, Shader=gradient, Thickness=remap.Mapped, Absolute=False)
