# Grasshopper definition 170218_structural aesthetics workshop_BONE.gh (Grasshopper 0.9.76)
# plug-ins: Volvox, Anemone, Human, Kangaroo Components, Weaverbird, Kangaroo2 Components

# ----
# shape generation and topology
crv = Curve(<curve referenced from the Rhino model>)  # disabled
number_slider = Slider(3000, range=0..3000)  # disabled
boundary = BoundarySurfaces(Edges=crv)  # disabled
popgeo = PopulateGeometry(Geometry=boundary, Count=number_slider, Seed=1)  # disabled
number_slider_2 = Slider(22, range=0..100)  # disabled
con = DelaunayEdges(Points=popgeo, Plane=PlaneXY(0, 0, 0))  # -> Connectivity, Edges; disabled
len = Length(Curve=con.Edges)  # disabled
smaller = SmallerThan(FirstNumber=len, SecondNumber=number_slider_2)  # -> SmallerThan, OrEqualTo; disabled
dispatch = Dispatch(List=con.Edges, DispatchPattern=smaller.SmallerThan)  # -> ListA, ListB; disabled
crv_2 = Curve(dispatch.ListA)  # disabled

crv_3 = Curve([<curve referenced from the Rhino model> x5000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])
support = Curve(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)

# ---- group: load
crv_4 = Curve(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)

# ----
wbweave = WeaverbirdsMeshFromLinesWeaveBack(Lines=crv_3, MaximumValence=4)

# ---- group: these ones control both the loop and kangaroo
start_simulation = BooleanToggle(False)
reset_kangaroo = Button()

# ----
# stiffness loops through anemone and it increases or decreases based on the evalued deformation.
# The more a spring deforms, the stiffer it becomes
initial_stiffness = Slider(100, range=0..2100)
demesh = DeconstructMesh(Mesh=wbweave)  # -> Vertices, Faces, Colours, Normals

crv_5 = Curve(crv_3)
dupln = RemoveDuplicateLines(Lines=crv_5, Tolerance=0.01)
incurves = PointInCurves(Point=demesh.Vertices, Curves=support)  # -> Relationship, Index, Point
incurves_2 = PointInCurves(Point=demesh.Vertices, Curves=crv_4)  # -> Relationship, Index, Point
dispatch_2 = Dispatch(List=demesh.Vertices, DispatchPattern=incurves_2.Relationship)  # -> ListA, ListB
dispatch_3 = Dispatch(List=demesh.Vertices, DispatchPattern=incurves.Relationship)  # -> ListA, ListB

# ---- group: visualize points
pt = Point(demesh.Vertices)
lng = ListLength(List=pt)
repeat = RepeatData(Data=ColourSwatch(SwatchColor=RGB(59, 59, 59)), Length=lng)
cloud = ConstructCloud(Points=pt, Colors=repeat)

# ----
lng_2 = ListLength(List=dupln)
# enable this >
repeat_2 = RepeatData(Data=initial_stiffness, Length=lng_2)
not = GateNot(A=start_simulation)

# ---- group: LOADS
suppports = Point(dispatch_2.ListA)

# ---- group: SUPPORTS
suppports_2 = Point(dispatch_3.ListA)

# ----
Y = UnitY(Factor=Slider(20, range=0..220))
len_2 = Length(Curve=dupln)
neg = Negative(Value=Y)

loop_start = LoopStart(Repeat=Slider(100, range=0..100), Trigger=not, Data=repeat_2)  # -> port, Counter, flatten(Data); disabled

anchor = Anchor(Point=suppports_2, Strength=1000)
length_line = LengthLine(Line=dupln, Length=len_2, Strength=loop_start.Data)
load = Load(Point=suppports, ForceVector=neg)

solver = Solver(GoalObjects=[anchor, length_line, load], Reset=reset_kangaroo, Threshold=1e-15, Tolerance=0.01, On=start_simulation)  # -> I, V, O

kangarooo_iterations = Panel(solver.I)
anemone_iterations = Panel(loop_start.Counter)

clean = CleanTree(RemoveNulls=True, RemoveInvalid=True, RemoveEmpty=False, Tree=solver.O)

# ---- group: deformation
len_3 = Length(Curve=dupln)
len_4 = Length(Curve=clean)
subtraction = Subtraction(A=len_4, B=len_3)
division = Division(A=subtraction, B=len_3)

# ---- group: modulate stiffness based on deformation
abs = Absolute(Value=division)  # -> flatten(Result)
dom = ConstructDomain(DomainStart=0, DomainEnd=1)
bnd = Bounds(Numbers=abs)
remap = RemapNumbers(Value=abs, Source=bnd, Target=dom)  # -> Mapped, Clipped
graph = GraphMapper(
    remap.Mapped,
    x0=0,
    x1=1,
    y0=0,
    y1=1,
    container_name="Bezier",
    cpx=[0, 0.003623188473, 0.7644927502, 1],
    cpy=[0, 0.7155797482, 0.461956501, 1])
max_stiffness = Slider(1000, range=0..1000)
min_stiffness = Slider(1, range=-410..1000)
bnd_2 = Bounds(Numbers=graph)
dom_2 = ConstructDomain(DomainStart="10", DomainEnd="-10")
remap_2 = RemapNumbers(Value=graph, Source=bnd_2, Target=dom_2)  # -> Mapped, Clipped
addition = Addition(A=loop_start.Data, B=remap_2.Mapped)
min = Minimum(A=addition, B=max_stiffness)
max = Maximum(A=min, B=min_stiffness)
bnd_3 = Bounds(Numbers=max)

# ---- group: stiffness distribution
num = Number(max)
panel = Panel(bnd_3)
bar_graph = BarGraph(num, BarColor=RGB(81, 0, 255))

# ---- group: strain visualization absolut value
abs_2 = Absolute(Value=subtraction)
bnd_4 = Bounds(Numbers=abs_2)
remap_3 = RemapNumbers(Value=abs_2, Source=bnd_4, Target=Domain(0, 1))  # -> Mapped, Clipped
graph_2 = GraphMapper(remap_3.Mapped, x0=0, x1=1, y0=0, y1=1, container_name="Bezier", cpx=[0, 0, 0, 1], cpy=[0, 0.6642857194, 1, 1])
gradient = Gradient(LowerLimit=0, UpperLimit=1, Parameter=graph_2, stops=[0: RGB(255, 255, 255), 1: RGB(255, 0, 0)])
curvepoint = PointOnCurve(clean, parameter=0.5)
cloud_2 = ConstructCloud(Points=curvepoint, Colors=gradient)

# ---- group: strain visualization (compression tension)
deformation_percentage = Slider(0.02, range=0..0.1)
neg_2 = Negative(Value=deformation_percentage)
gradient_2 = Gradient(
    LowerLimit=neg_2,
    UpperLimit=deformation_percentage,
    Parameter=subtraction,
    stops=[0: RGB(0, 255, 160), 0.166: RGB(0, 0, 0), 0.441: RGB(0, 0, 0), 0.779: RGB(220, 0, 40)])
gradient_3 = Gradient(
    LowerLimit=neg_2,
    UpperLimit=deformation_percentage,
    Parameter=subtraction,
    stops=[0.495: RGB(0, 0, 0), 1: RGB(255, 255, 255)])
remap_4 = RemapNumbers(Value=abs_2, Source=bnd_4, Target="1 to 3")  # -> Mapped, Clipped
previewlw = CustomPreviewLineweights(Geometry=clean, Shader=gradient_3, Thickness=remap_4.Mapped, Absolute=False)
previewlw_2 = CustomPreviewLineweights(Geometry=clean, Shader=gradient_2, Thickness=remap_4.Mapped, Absolute=False)

# ----
running = Running(port=loop_start.port, Exit=not, Data=flatten(max), pausedState=False, state="Constant output", TimeOutVal=0)

dam = DataDam(DataA=clean, BufferDelay=10000000, BufferMode=0)
dam_2 = DataDam(DataA=division, BufferDelay=10000000, BufferMode=0)

smaller_2 = SmallerThan(FirstNumber=dam_2, SecondNumber="0")  # -> SmallerThan, OrEqualTo
dispatch_4 = Dispatch(List=dam, DispatchPattern=smaller_2.SmallerThan)  # -> Compression, Tension
wbweave_2 = WeaverbirdsMeshFromLinesWeaveBack(Lines=dam, MaximumValence=4)

line = Line(dispatch_4.Tension)
# bundling
line_2 = Line(dispatch_4.Compression)
divide = DivideCurve(Curve=line_2, Count=10, Kinks=False)  # -> flatten(Points), Tangents, Parameters; disabled
number_slider_3 = Slider(1.5, range=0..10)  # disabled
number_slider_4 = Slider(0.5, range=0..1.25)  # disabled
number_slider_5 = Slider(5, range=0..10)  # disabled
number_slider_6 = Slider(1.25, range=0..10)  # disabled
prox = Proximity3D(Points=divide.Points, Group=number_slider_5, MinRadius=number_slider_4, MaxRadius=number_slider_3)  # -> Links, Topology; disabled
line_3 = Line(flatten(prox.Links))  # disabled
len_5 = Length(Curve=line_3)  # disabled
larger = LargerThan(FirstNumber=len_5, SecondNumber=number_slider_6)  # -> LargerThan, OrEqualTo; disabled
dispatch_5 = Dispatch(List=line_3, DispatchPattern=larger.OrEqualTo)  # -> ListA, ListB; disabled
line_4 = Line(dispatch_5.ListA)  # disabled
number_slider_7 = Slider(0.001, range=0..0.001)  # disabled
curvepoint_2 = PointOnCurve(line_4, parameter=0.5)  # disabled
cullpt = CullDuplicates(Points=curvepoint_2, Tolerance=number_slider_7, CullMode=1)  # -> Points, Indices, Valence; disabled
item = ListItem(List=line_4, Index=cullpt.Indices, Wrap=True)  # disabled
number_slider_8 = Slider(0.7, range=0..1)  # disabled
number_slider_9 = Slider(1000, range=0..1000)  # disabled
len_6 = Length(Curve=line_2)  # disabled
multiplication = Multiplication(A=len_6, B=number_slider_8)  # disabled
panel_2 = Panel("-1.5")  # disabled
panel_3 = Panel("-2")  # disabled
springs = SpringsFromLine(
    Connection=line_2,
    Stiffness=number_slider_9,
    Damping=10,
    RestLength=multiplication,
    UpperCutoff=0,
    LowerCutoff=0,
    Plasticity=0)  # disabled
plaw = PowerLaw(Connection=item, Exponents=panel_3, Strength=panel_2, Cutoff=0)  # disabled
nv = NakedVertices(Mesh=wbweave_2)  # -> ClothedIndex, NakedIndex, ClothedPts, NakedPts; disabled
pt_2 = Point(nv.NakedPts)  # disabled
toggle = BooleanToggle(False)  # disabled
timer = Timer(TimerInterval=100, Target=kangaroo)  # disabled
kangaroo = KangarooPhysics(
    ForceObjects=flatten([springs, plaw]),
    AnchorPoints=flatten(pt_2),
    Settings=null,
    Geometry=flatten(line_2),
    SimulationReset=toggle)  # -> Out, Iterations, ParticlesOut, GeometryOut, KE; disabled
crv_6 = Curve(kangaroo.GeometryOut)  # disabled
len_7 = Length(Curve=crv_6)  # disabled
subtraction_2 = Subtraction(A=len_7, B=len_6)  # disabled
panel_4 = Panel("-2")  # disabled
panel_5 = Panel("2")  # disabled
gradient_4 = Gradient(
    LowerLimit=panel_4,
    UpperLimit=panel_5,
    Parameter=subtraction_2,
    stops=[0: RGB(0, 0, 0), 0.0493: RGB(0, 0, 0), 0.621: RGB(0, 255, 157)])  # disabled
preview = CustomPreview(Geometry=crv_6, Shader=gradient_4)  # disabled

# ---- group: this allow to save frame of simulation into a specified folder
number_slider_10 = Slider(10, range=0..10)  # disabled
int = Integer(kangaroo.Iterations)  # disabled
division_2 = Division(A=int, B=number_slider_10)  # disabled
panel_6 = Panel("D:\Documenti\#STRUCTURAL AESTHETICS\day3\pres\video\osso bundling 1")  # disabled
panel_7 = Panel("image")  # disabled
panel_8 = Panel("_")  # disabled
int_2 = Integer(division_2)  # disabled
concat = Concatenate(FragmentA=panel_7, FragmentB=panel_8, FragmentC=int_2)  # disabled
mbe_capture_to_file = CSharpScript(capture=int, folder=panel_6, name=concat)  # -> out, A; inputs capture: Boolean, folder: String, name: String; disabled
# ---------- mbe_capture_to_file: C# ----------
    _counter++;

    string file =
      '"' + folder + System.IO.Path.DirectorySeparatorChar + name + ".jpg" + '"';
    string command = "-_ViewCaptureToFile " + file + " Scale=1 _Enter";

    if (capture)
      RhinoApp.RunScript(command, false);
# ---------- mbe_capture_to_file: C# additional code ----------
  private int _counter = -1;
# ---------- end mbe_capture_to_file ----------
