# Grasshopper definition SpiderWeb.gh (Grasshopper 0.9.76)
# plug-ins: Kangaroo Components

geo = Geometry([<curve referenced from the Rhino model> x2])
explode = Explode(Curve=geo, Recursive=True)  # -> Segments, Vertices
divide = DivideCurve(Curve=explode.Segments, Count=Slider(5, range=0..20), Kinks=False)  # -> Points, Tangents, Parameters
end = EndPoints(Curve=explode.Segments)  # -> Start, End
pcen = PolygonCenter(Polyline=geo)  # -> CenterV, CenterE, CenterA
trim = TrimTree(Tree=divide.Points, Depth=Slider(1, range=0..10))
cullpt = CullDuplicates(Points=trim, Tolerance=0.1, CullMode=3)  # -> Points, Indices, Valence
geo_2 = Geometry(<curve referenced from the Rhino model>)
pt = Point(graft(pcen.CenterV))
cp = ControlPoints(Curve=geo_2)  # -> Points, Weights, Knots
ln = Line(StartPoint=pt, EndPoint=cullpt.Points)
pcen_2 = PolygonCenter(Polyline=geo_2)  # -> CenterV, CenterE, CenterA
mcx = MultipleCurves(Curves=geo_2)  # -> Points, IndexA, IndexB, ParamA, ParamB
disc = Discontinuity(Curve=geo_2, Level=1)  # -> Points, Parameters
divide_2 = DivideCurve(Curve=ln, Count=Slider(7, range=0..20), Kinks=False)  # -> Points, Tangents, Parameters
pt_2 = Point(graft(pcen_2.CenterV))
cullpt_2 = CullDuplicates(Points=mcx.Points, Tolerance=0.1, CullMode=3)  # -> Points, Indices, Valence
pt_3 = Point(simplify(graft(divide_2.Points)))
ln_2 = Line(StartPoint=pt_2, EndPoint=disc.Points)
dist = Distance(PointA=cullpt_2.Points, PointB=graft(cp.Points))
pt_4 = Point(flatten(cp.Points))
divide_3 = DivideCurve(Curve=ln_2, Count=Slider(9, range=0..20), Kinks=False)  # -> Points, Tangents, Parameters
path_mapper = PathMapper(pt_3, source="{A;B;C}(i)", target="{A;C;i}(B)")
smaller = SmallerThan(FirstNumber=dist, SecondNumber=Slider(0.001, range=0..0.001))  # -> SmallerThan, OrEqualTo
viewer = ParamViewer(pt_3)
shatter = Shatter(Curve=ln, Parameters=flatten(divide_2.Parameters))  # -> flatten(Segments)
pt_5 = Point(divide_3.Points)
int = Integer(smaller.SmallerThan)
ma = MassAddition(Input=int)  # -> Result, PartialResults
path_mapper_2 = PathMapper(pt_5, source="{A;B;C}(i)", target="{A;B;i}(C)")
viewer_2 = ParamViewer(pt_5)
pline = PolyLine(Vertices=path_mapper, Closed=True)  # -> flatten(Polyline)
larger = LargerThan(FirstNumber=ma.Result, SecondNumber=0)  # -> flatten(LargerThan), OrEqualTo
explode_2 = Explode(Curve=pline, Recursive=True)  # -> flatten(Segments), Vertices
dispatch = Dispatch(List=pt_4, DispatchPattern=larger.LargerThan)  # -> ListA, ListB
pline_2 = PolyLine(Vertices=path_mapper_2, Closed=True)  # -> flatten(Polyline)
panel = Panel(viewer_2)
len = Length(Curve=explode_2.Segments)
panel_2 = Panel(pline)
pt_6 = Point(dispatch.ListB)
explode_3 = Explode(Curve=pline_2, Recursive=True)  # -> flatten(Segments), Vertices
shatter_2 = Shatter(Curve=ln_2, Parameters=flatten(divide_3.Parameters))  # -> flatten(Segments)
smaller_2 = SmallerThan(FirstNumber=len, SecondNumber=Slider(0.001, range=0..0.001))  # -> SmallerThan, OrEqualTo
len_2 = Length(Curve=explode_3.Segments)
dispatch_2 = Dispatch(List=explode_2.Segments, DispatchPattern=smaller_2.SmallerThan)  # -> ListA, ListB
equals = Equality(FirstNumber=len_2, SecondNumber=Slider(0, range=0..1))  # -> Equality, Inequality
dupln = RemoveDuplicateLines(Lines=dispatch_2.ListB, Tolerance=0.01)
dupln_2 = RemoveDuplicateLines(Lines=shatter, Tolerance=0.01)
dispatch_3 = Dispatch(List=explode_3.Segments, DispatchPattern=equals.Equality)  # -> ListA, ListB
number_slider = Slider(351, range=0..1000)
duppt = RemoveDuplicatePts(Points=divide_2.Points, Tolerance=0.01)
cp_2 = ControlPoints(Curve=shatter_2)  # -> Points, Weights, Knots
Z = UnitZ(Factor=Slider(71.366, range=-500..500))
springs = SpringsFromLine(
    Connection=dispatch_3.ListB,
    Stiffness=Slider(67, range=0..1000),
    Damping=10,
    RestLength=0,
    UpperCutoff=0,
    LowerCutoff=0,
    Plasticity=0)
springs_2 = SpringsFromLine(
    Connection=shatter_2,
    Stiffness=Slider(460, range=0..1000),
    Damping=10,
    RestLength=0,
    UpperCutoff=0,
    LowerCutoff=0,
    Plasticity=0)
Z_2 = UnitZ(Factor=Slider(102.18, range=-200..800))
uforce = UnaryForce(Point=cp_2.Points, Force=Z)
springs_3 = SpringsFromLine(
    Connection=dupln,
    Stiffness=Slider(153, range=0..1000),
    Damping=10,
    RestLength=0,
    UpperCutoff=0,
    LowerCutoff=0,
    Plasticity=0)
springs_4 = SpringsFromLine(
    Connection=dupln_2,
    Stiffness=Slider(158, range=0..1000),
    Damping=10,
    RestLength=0,
    UpperCutoff=0,
    LowerCutoff=0,
    Plasticity=0)
uforce_2 = UnaryForce(Point=duppt, Force=Z_2)
timer = Timer(TimerInterval=100, Target=kangaroo)  # disabled
timer_2 = Timer(TimerInterval=50, Target=kangaroo_2)  # disabled
kangaroo = KangarooPhysics(
    ForceObjects=flatten([springs, uforce, springs_2]),
    AnchorPoints=flatten(pt_6),
    Settings=null,
    Geometry=[shatter_2, dispatch_3.ListB],
    SimulationReset=Toggle(True))  # -> Out, Iterations, ParticlesOut, GeometryOut, KE
kangaroo_2 = KangarooPhysics(
    ForceObjects=flatten([springs_3, uforce_2, springs_4]),
    AnchorPoints=flatten(end.Start),
    Settings=null,
    Geometry=[dupln_2, dupln],
    SimulationReset=Toggle(True))  # -> Out, Iterations, ParticlesOut, GeometryOut, KE
pipe = Pipe(Curve=kangaroo.GeometryOut, Radius=Slider(0.2, range=0..1), Caps=0)  # disabled
line = Line(kangaroo.GeometryOut)
pipe_2 = Pipe(Curve=kangaroo_2.GeometryOut, Radius=Slider(0.2, range=0..1), Caps=0)  # disabled
line_2 = Line(kangaroo_2.GeometryOut)
geo_3 = Geometry([<curve referenced from the Rhino model> x7])
cp_3 = ControlPoints(Curve=geo_3)  # -> Points, Weights, Knots
pcen_3 = PolygonCenter(Polyline=geo_3)  # -> CenterV, CenterE, CenterA
mcx_2 = MultipleCurves(Curves=geo_3)  # -> Points, IndexA, IndexB, ParamA, ParamB
disc_2 = Discontinuity(Curve=geo_3, Level=1)  # -> Points, Parameters
pt_7 = Point(graft(pcen_3.CenterV))
cullpt_3 = CullDuplicates(Points=mcx_2.Points, Tolerance=0.1, CullMode=3)  # -> Points, Indices, Valence
ln_3 = Line(StartPoint=pt_7, EndPoint=disc_2.Points)
dist_2 = Distance(PointA=cullpt_3.Points, PointB=graft(cp_3.Points))
pt_8 = Point(flatten(cp_3.Points))
divide_4 = DivideCurve(Curve=ln_3, Count=Slider(8, range=0..20), Kinks=False)  # -> Points, Tangents, Parameters
smaller_3 = SmallerThan(FirstNumber=dist_2, SecondNumber=Slider(0.001, range=0..0.001))  # -> SmallerThan, OrEqualTo
geo_4 = Geometry([<curve referenced from the Rhino model> x7])
pt_9 = Point(divide_4.Points)
int_2 = Integer(smaller_3.SmallerThan)
explode_4 = Explode(Curve=geo_4, Recursive=True)  # -> Segments, Vertices
ma_2 = MassAddition(Input=int_2)  # -> Result, PartialResults
path_mapper_3 = PathMapper(pt_9, source="{A;B;C}(i)", target="{A;B;i}(C)")
divide_5 = DivideCurve(Curve=explode_4.Segments, Count=Slider(3, range=0..20), Kinks=False)  # -> Points, Tangents, Parameters
viewer_3 = ParamViewer(pt_9)
larger_2 = LargerThan(FirstNumber=ma_2.Result, SecondNumber=0)  # -> flatten(LargerThan), OrEqualTo
pcen_4 = PolygonCenter(Polyline=geo_4)  # -> CenterV, CenterE, CenterA
trim_2 = TrimTree(Tree=divide_5.Points, Depth=Slider(1, range=0..10))
mcx_3 = MultipleCurves(Curves=geo_4)  # -> Points, IndexA, IndexB, ParamA, ParamB
cp_4 = ControlPoints(Curve=geo_4)  # -> Points, Weights, Knots
dispatch_4 = Dispatch(List=pt_8, DispatchPattern=larger_2.LargerThan)  # -> ListA, ListB
pline_3 = PolyLine(Vertices=path_mapper_3, Closed=True)  # -> flatten(Polyline)
panel_3 = Panel(viewer_3)
cullpt_4 = CullDuplicates(Points=trim_2, Tolerance=0.1, CullMode=3)  # -> Points, Indices, Valence
pt_10 = Point(graft(pcen_4.CenterV))
cullpt_5 = CullDuplicates(Points=mcx_3.Points, Tolerance=0.1, CullMode=3)  # -> Points, Indices, Valence
pt_11 = Point(dispatch_4.ListB)
explode_5 = Explode(Curve=pline_3, Recursive=True)  # -> flatten(Segments), Vertices
shatter_3 = Shatter(Curve=ln_3, Parameters=flatten(divide_4.Parameters))  # -> flatten(Segments)
dist_3 = Distance(PointA=cullpt_5.Points, PointB=graft(cp_4.Points))
pt_12 = Point(flatten(cp_4.Points))
len_3 = Length(Curve=explode_5.Segments)
ln_4 = Line(StartPoint=pt_10, EndPoint=cullpt_4.Points)
smaller_4 = SmallerThan(FirstNumber=dist_3, SecondNumber=Slider(0.001, range=0..0.001))  # -> SmallerThan, OrEqualTo
equals_2 = Equality(FirstNumber=len_3, SecondNumber=Slider(0, range=0..1))  # -> Equality, Inequality
divide_6 = DivideCurve(Curve=ln_4, Count=Slider(3, range=0..20), Kinks=False)  # -> Points, Tangents, Parameters
int_3 = Integer(smaller_4.SmallerThan)
dispatch_5 = Dispatch(List=explode_5.Segments, DispatchPattern=equals_2.Equality)  # -> ListA, ListB
pt_13 = Point(simplify(graft(divide_6.Points)))
ma_3 = MassAddition(Input=int_3)  # -> Result, PartialResults
larger_3 = LargerThan(FirstNumber=ma_3.Result, SecondNumber=0)  # -> flatten(LargerThan), OrEqualTo
path_mapper_4 = PathMapper(pt_13, source="{A;B;C}(i)", target="{A;C;i}(B)")
viewer_4 = ParamViewer(pt_13)
cp_5 = ControlPoints(Curve=shatter_3)  # -> Points, Weights, Knots
Z_3 = UnitZ(Factor=Slider(79.559, range=-500..500))
shatter_4 = Shatter(Curve=ln_4, Parameters=flatten(divide_6.Parameters))  # -> flatten(Segments)
dispatch_6 = Dispatch(List=pt_12, DispatchPattern=larger_3.LargerThan)  # -> ListA, ListB
springs_5 = SpringsFromLine(
    Connection=dispatch_5.ListB,
    Stiffness=Slider(52, range=0..1000),
    Damping=10,
    RestLength=0,
    UpperCutoff=0,
    LowerCutoff=0,
    Plasticity=0)
springs_6 = SpringsFromLine(
    Connection=shatter_3,
    Stiffness=Slider(546, range=0..1000),
    Damping=10,
    RestLength=0,
    UpperCutoff=0,
    LowerCutoff=0,
    Plasticity=0)
uforce_3 = UnaryForce(Point=cp_5.Points, Force=Z_3)
pt_14 = Point(dispatch_6.ListB)
pline_4 = PolyLine(Vertices=path_mapper_4, Closed=True)  # -> flatten(Polyline)
timer_3 = Timer(TimerInterval=100, Target=kangaroo_3)  # disabled
explode_6 = Explode(Curve=pline_4, Recursive=True)  # -> flatten(Segments), Vertices
len_4 = Length(Curve=explode_6.Segments)
panel_4 = Panel(pline_4)
kangaroo_3 = KangarooPhysics(
    ForceObjects=flatten([springs_5, uforce_3, springs_6]),
    AnchorPoints=flatten(pt_11),
    Settings=null,
    Geometry=[shatter_3, dispatch_5.ListB],
    SimulationReset=Toggle(True))  # -> Out, Iterations, ParticlesOut, GeometryOut, KE
smaller_5 = SmallerThan(FirstNumber=len_4, SecondNumber=Slider(0.001, range=0..0.001))  # -> SmallerThan, OrEqualTo
dispatch_7 = Dispatch(List=explode_6.Segments, DispatchPattern=smaller_5.SmallerThan)  # -> ListA, ListB
dupln_3 = RemoveDuplicateLines(Lines=dispatch_7.ListB, Tolerance=0.01)
dupln_4 = RemoveDuplicateLines(Lines=shatter_4, Tolerance=0.01)
pipe_3 = Pipe(Curve=kangaroo_3.GeometryOut, Radius=Slider(0.2, range=0..1), Caps=0)  # disabled
duppt_2 = RemoveDuplicatePts(Points=pt_14, Tolerance=0.01)
line_3 = Line(kangaroo_3.GeometryOut)
number_slider_2 = Slider(301, range=0..1000)
duppt_3 = RemoveDuplicatePts(Points=divide_6.Points, Tolerance=0.01)
Z_4 = UnitZ(Factor=Slider(144.747, range=-200..800))
springs_7 = SpringsFromLine(
    Connection=dupln_3,
    Stiffness=Slider(214, range=0..1000),
    Damping=10,
    RestLength=0,
    UpperCutoff=0,
    LowerCutoff=0,
    Plasticity=0)
springs_8 = SpringsFromLine(
    Connection=dupln_4,
    Stiffness=Slider(145, range=0..1000),
    Damping=10,
    RestLength=0,
    UpperCutoff=0,
    LowerCutoff=0,
    Plasticity=0)
uforce_4 = UnaryForce(Point=duppt_3, Force=Z_4)
timer_4 = Timer(TimerInterval=50, Target=kangaroo_4)  # disabled
kangaroo_4 = KangarooPhysics(
    ForceObjects=flatten([springs_7, uforce_4, springs_8]),
    AnchorPoints=flatten(duppt_2),
    Settings=null,
    Geometry=[dupln_4, dupln_3],
    SimulationReset=Toggle(True))  # -> Out, Iterations, ParticlesOut, GeometryOut, KE
line_4 = Line(kangaroo_4.GeometryOut)
pipe_4 = Pipe(Curve=kangaroo_4.GeometryOut, Radius=Slider(0.2, range=0..1), Caps=0)  # disabled
