# Grasshopper definition SpiderWeb_stress_K2.gh (Grasshopper 0.9.76)
# plug-ins: Kangaroo Components, Kangaroo2 Components

geo = Geometry([<curve referenced from the Rhino model> x7])
explode = Explode(Curve=geo, Recursive=True)  # -> Segments, Vertices
divide = DivideCurve(Curve=explode.Segments, Count=Slider(3, range=0..20), Kinks=False)  # -> Points, Tangents, Parameters
pcen = PolygonCenter(Polyline=geo)  # -> CenterV, CenterE, CenterA
trim = TrimTree(Tree=divide.Points, Depth=Slider(1, range=0..10))
mcx = MultipleCurves(Curves=geo)  # -> Points, IndexA, IndexB, ParamA, ParamB
cp = ControlPoints(Curve=geo)  # -> Points, Weights, Knots
cullpt = CullDuplicates(Points=trim, Tolerance=0.1, CullMode=3)  # -> Points, Indices, Valence
pt = Point(graft(pcen.CenterV))
cullpt_2 = CullDuplicates(Points=mcx.Points, Tolerance=0.1, CullMode=3)  # -> Points, Indices, Valence
dist = Distance(PointA=cullpt_2.Points, PointB=graft(cp.Points))
pt_2 = Point(flatten(cp.Points))
ln = Line(StartPoint=pt, EndPoint=cullpt.Points)
smaller = SmallerThan(FirstNumber=dist, SecondNumber=Slider(0.001, range=0..0.001))  # -> SmallerThan, OrEqualTo
divide_2 = DivideCurve(Curve=ln, Count=Slider(3, range=0..20), Kinks=False)  # -> Points, Tangents, Parameters
int = Integer(smaller.SmallerThan)
pt_3 = Point(simplify(graft(divide_2.Points)))
ma = MassAddition(Input=int)  # -> Result, PartialResults
larger = LargerThan(FirstNumber=ma.Result, SecondNumber=0)  # -> flatten(LargerThan), OrEqualTo
path_mapper = PathMapper(pt_3, source="{A;B;C}(i)", target="{A;C;i}(B)")
viewer = ParamViewer(pt_3)
shatter = Shatter(Curve=ln, Parameters=flatten(divide_2.Parameters))  # -> flatten(Segments)
dispatch = Dispatch(List=pt_2, DispatchPattern=larger.LargerThan)  # -> ListA, ListB
pt_4 = Point(dispatch.ListB)
pline = PolyLine(Vertices=path_mapper, Closed=True)  # -> flatten(Polyline)
explode_2 = Explode(Curve=pline, Recursive=True)  # -> flatten(Segments), Vertices
len = Length(Curve=explode_2.Segments)
panel = Panel(pline)
smaller_2 = SmallerThan(FirstNumber=len, SecondNumber=Slider(0.001, range=0..0.001))  # -> SmallerThan, OrEqualTo
dispatch_2 = Dispatch(List=explode_2.Segments, DispatchPattern=smaller_2.SmallerThan)  # -> ListA, ListB
duppt = RemoveDuplicatePts(Points=divide_2.Points, Tolerance=0.01)
duppt_2 = RemoveDuplicatePts(Points=pt_4, Tolerance=0.01)
dupln = RemoveDuplicateLines(Lines=dispatch_2.ListB, Tolerance=0.01)
dupln_2 = RemoveDuplicateLines(Lines=shatter, Tolerance=0.01)
len_2 = Length(Curve=dupln)
len_3 = Length(Curve=dupln_2)
number_slider = Slider(214, range=0..1000)
multiplication = Multiplication(A=len_2, B=Slider(0, range=0..1))
multiplication_2 = Multiplication(A=len_3, B=Slider(0, range=0..1))
Z = UnitZ(Factor=Slider(144.747, range=-200..800))
length_line = LengthLine(Line=dupln, Length=multiplication, Strength=number_slider)
anchor = Anchor(Point=duppt_2, Strength=Slider(100000, range=1000..100000))
length_line_2 = LengthLine(Line=dupln_2, Length=multiplication_2, Strength=Slider(145, range=0..1000))
load = Load(Point=duppt, ForceVector=Z)
on = BooleanToggle(False)
reset = Button()
solver = Solver(GoalObjects=[anchor, length_line, length_line_2, load], Reset=reset, Threshold=1e-15, Tolerance=0.01, On=on)  # -> I, V, O
merge = Merge(Data1=dupln, Data2=dupln_2)
clean = CleanTree(RemoveNulls=True, RemoveInvalid=True, RemoveEmpty=False, Tree=solver.O)
len_4 = Length(Curve=clean)
len_5 = Length(Curve=merge)
number_slider_2 = Slider(0, range=0..677)
subtraction = Subtraction(A=len_4, B=len_5)
multiplication_3 = Multiplication(A=number_slider, B=subtraction)
item = ListItem(List=clean, Index=number_slider_2, Wrap=True)
item_2 = ListItem(List=merge, Index=number_slider_2, Wrap=True)
gradient = Gradient(
    LowerLimit=Slider(-880, range=-5000..0),
    UpperLimit=Slider(160, range=0..5000),
    Parameter=multiplication_3,
    stops=[0: RGB(0, 128, 0), 0.5: RGB(255, 255, 0), 1: RGB(255, 0, 0)])
end = EndPoints(Curve=item)  # -> Start, End
end_2 = EndPoints(Curve=item_2)  # -> Start, End
pipe = Pipe(Curve=clean, Radius=Slider(0.484, range=0..1), Caps=0)  # disabled
curvepoint = PointOnCurve(clean, parameter=0.5)
ln_2 = Line(StartPoint=end_2.Start, EndPoint=end.Start)
ln_3 = Line(StartPoint=end_2.End, EndPoint=end.End)
preview = CustomPreview(Geometry=flatten(clean), Shader=gradient)
tag = TextTag(Location=curvepoint, Text=multiplication_3, Colour=gradient)  # disabled
preview_2 = CustomPreview(
    Geometry=[ln_2, ln_3],
    Shader={ambient=RGB(0, 0, 0), diffuse=RGB(255, 105, 180), emission=RGB(76, 32, 54), shine=0.5, specular=RGB(255, 255, 255), transparency=0})
tstat = TreeStatistics(Tree=pipe)  # -> Paths, Length, Count
repeat = RepeatData(Data="Colour_", Length=tstat.Count)  # -> simplify(graft(Data))
series = Series(Start=1, Step=1, Count=tstat.Count)  # -> simplify(graft(Series))
int_2 = Integer(series)
join = StringJoin(Strings=[repeat, int_2])
bakeattributes = CSharpScript(obj=pipe, name=join, layer=join, color=gradient, material=gradient, activate=Button())  # -> out; inputs obj: GeometryBase, name: String, layer: String, color: Color, pWidth: Double, wires: Int32, activate: Boolean; disabled
# ---------- bakeattributes: C# ----------
    //Inserts geometry into the Rhino document, with custom attributes
    //Written by Giulio Piacentino
    //Version written 2010 11 21 - for Grasshopper 0.8.002

    if (activate)
    {
      if(obj == null)
      {
        Print("No object to bake");
        return;
      }

      //Make new attribute to set name
      Rhino.DocObjects.ObjectAttributes att = new Rhino.DocObjects.ObjectAttributes();

      //Set object name
      if(!string.IsNullOrEmpty(name))
      {
        att.Name = name;
      }

      //Set color
      if(!color.IsEmpty)
      {
        att.ColorSource = Rhino.DocObjects.ObjectColorSource.ColorFromObject; //Make the color type "by object"
        att.ObjectColor = color;

        att.PlotColorSource = Rhino.DocObjects.ObjectPlotColorSource.PlotColorFromObject; //Make the plot color type "by object"
        att.PlotColor = color;
      }

      //Set layer
      if(!string.IsNullOrEmpty(layer) && Rhino.DocObjects.Layer.IsValidName(layer))
      {
        //Get the current layer index
        Rhino.DocObjects.Tables.LayerTable layerTable = doc.Layers;
        int layerIndex = layerTable.Find(layer, true);

        if(layerIndex < 0) //This layer does not exist, we add it
        {
          Rhino.DocObjects.Layer onlayer = new Rhino.DocObjects.Layer(); //Make a new layer
          onlayer.Name = layer;

          layerIndex = layerTable.Add(onlayer); //Add the layer to the layer table
          if (layerIndex > -1) //We manged to add layer!
          {
            att.LayerIndex = layerIndex;
            Print("Added new layer to the document at position " + layerIndex + " named " + layer + ". ");
          } else
            Print("Layer did not add. Try cleaning up your layers."); //This never happened to me.
        }
        else
          att.LayerIndex = layerIndex; //We simply add to the existing layer
      }


      //Set plotweight
      if(pWidth > 0)
      {
        att.PlotWeightSource = Rhino.DocObjects.ObjectPlotWeightSource.PlotWeightFromObject;
        att.PlotWeight = pWidth;
      }


      //Set material
      bool materialByName = !string.IsNullOrEmpty(material as string);
      Rhino.Display.DisplayMaterial inMaterial = material as Rhino.Display.DisplayMaterial;
      if(material is Color)
      {
        inMaterial = new Rhino.Display.DisplayMaterial((Color) material);
      }
      if(material != null && inMaterial == null && !materialByName)
      {
        if(!(material is string))
        {
          try //We also resort to try with IConvertible
          {
            inMaterial = (Rhino.Display.DisplayMaterial) Convert.ChangeType(material, typeof(Rhino.Display.DisplayMaterial));
          }
          catch(InvalidCastException)
          {
          }
        }
      }
      if(inMaterial != null || materialByName)
      {
        string matName;

        if(!materialByName)
        {
          matName = string.Format("A:{0}-D:{1}-E:{2}-S:{3},{4}-T:{5}",
            Format(inMaterial.Ambient),
            Format(inMaterial.Diffuse),
            Format(inMaterial.Emission),
            Format(inMaterial.Specular),
            inMaterial.Shine.ToString(),
            inMaterial.Transparency.ToString()
            );
        }
        else
        {
          matName = (string) material;
        }

        int materialIndex = doc.Materials.Find(matName, true);
        if(materialIndex < 0 && !materialByName) //Material does not exist and we have its specs
        {
          materialIndex = doc.Materials.Add(); //Let's add it
          if(materialIndex > -1)
          {
            Print("Added new material at position " + materialIndex + " named \"" + matName + "\". ");
            Rhino.DocObjects.Material m = doc.Materials[materialIndex];
            m.Name = matName;
            m.AmbientColor = inMaterial.Ambient;
            m.DiffuseColor = inMaterial.Diffuse;
            m.EmissionColor = inMaterial.Emission;
            //m.ReflectionColor = no equivalent
            m.SpecularColor = inMaterial.Specular;
            m.Shine = inMaterial.Shine;
            m.Transparency = inMaterial.Transparency;
            //m.TransparentColor = no equivalent
            m.CommitChanges();

            att.MaterialSource = Rhino.DocObjects.ObjectMaterialSource.MaterialFromObject;
            att.MaterialIndex = materialIndex;
          }
          else
            Print("Material did not add. Try cleaning up your materials."); //This never happened to me.
        }
        else if(materialIndex < 0 && materialByName) //Material does not exist and we do not have its specs. We do nothing
        {
          Print("Warning: material name not found. I cannot set the source to this material name. Add a material with name: " + matName);
        }
        else
        {
          //If this material exists, we do not replace it!
          att.MaterialSource = Rhino.DocObjects.ObjectMaterialSource.MaterialFromObject;
          att.MaterialIndex = materialIndex;
        }
      }


      //Set wire density
      if(wires == -1 || wires > 0)
      {
        att.WireDensity = wires;
      }


      //Bake to the right type of object
      switch(obj.ObjectType)
      {
        case Rhino.DocObjects.ObjectType.Brep:
          doc.Objects.AddBrep(obj as Brep, att);
          break;
        case Rhino.DocObjects.ObjectType.Curve:
          doc.Objects.AddCurve(obj as Curve, att);
          break;
        case Rhino.DocObjects.ObjectType.Point:
          doc.Objects.AddPoint((obj as Rhino.Geometry.Point).Location, att);
          break;
        case Rhino.DocObjects.ObjectType.Surface:
          doc.Objects.AddSurface(obj as Surface, att);
          break;
        case Rhino.DocObjects.ObjectType.Mesh:
          doc.Objects.AddMesh(obj as Mesh, att);
          break;
        case Rhino.DocObjects.ObjectType.Extrusion:
          typeof(Rhino.DocObjects.Tables.ObjectTable).InvokeMember("AddExtrusion", BindingFlags.Instance | BindingFlags.InvokeMethod, null, doc.Objects, new object[]{obj, att});
          break;
        case Rhino.DocObjects.ObjectType.PointSet:
          doc.Objects.AddPointCloud(obj as Rhino.Geometry.PointCloud, att); //This is a speculative entry
          break;
        default:
          Print("The script does not know how to handle this type of geometry: " + obj.GetType().FullName);
          break;
      }
      Print("Added " + obj.GetType().Name);

    }
    else
    {
      Print("Inactive");
    }
# ---------- bakeattributes: C# additional code ----------
  static string Format(Color c)
  {
    return (new System.Text.StringBuilder("A")).Append(c.A.ToString()).Append("R").Append(c.R.ToString()).Append("G")
      .Append(c.G.ToString()).Append("B").Append(c.B.ToString()).ToString();
  }
# ---------- end bakeattributes ----------
