# Grasshopper definition agent_system.gh (Grasshopper 0.9.76)
# plug-ins: Python Interpreter, Anemone

# ---- group: boundary
number_slider = Slider(300, range=0..1000)  # disabled
pt = ConstructPoint(XCoordinate=0, YCoordinate=0, ZCoordinate=0)  # disabled
pt_2 = ConstructPoint(XCoordinate=number_slider, YCoordinate=number_slider, ZCoordinate=number_slider)  # disabled
box = Box2Pt(PointA=pt, PointB=pt_2, Plane=PlaneXY(0, 0, 0))  # disabled

# ---- group: vectorField
number_slider_2 = Slider(0.9, range=0..1)  # disabled
number_slider_3 = Slider(458, range=0..1000)  # disabled
area = Area(Geometry=box)  # -> Area, Centroid; disabled
number_slider_4 = Slider(5, range=0..10)  # disabled
panel = Panel("-4.0 To 4.0")  # disabled
scale = Scale(Geometry=box, Center=area.Centroid, Factor=number_slider_2)  # -> Geometry, Transform; disabled
number_slider_5 = Slider(500, range=0..1000)  # disabled
pop3d = Populate3D(Region=scale.Geometry, Count=number_slider_4, Seed=number_slider_3)  # disabled
random = Random(Range=panel, Number=number_slider_4, Seed=2)  # disabled
number_slider_6 = Slider(7.2, range=0..10)  # disabled
number_slider_7 = Slider(1, range=0..10)  # disabled
pop3d_2 = Populate3D(Region=scale.Geometry, Count=number_slider_5, Seed=number_slider_3)  # disabled
fspin = SpinForce(Plane=pop3d, Strength=random, Radius=number_slider_6, Decay=number_slider_7)  # disabled
mergef = MergeFields(Fields=fspin)  # disabled
evf = EvaluateField(Field=mergef, Point=pop3d_2)  # -> simplify(flatten(Tensor)), Strength; disabled
bnd = Bounds(Numbers=evf.Strength)  # disabled
panel_2 = Panel(bnd)  # disabled
vdis = VectorDisplay(Anchor=pop3d_2, Vector=evf.Tensor)  # disabled
panel_3 = Panel("0.1 To 1")  # disabled
remap = RemapNumbers(Value=evf.Strength, Source=bnd, Target=panel_3)  # -> Mapped, Clipped; disabled
amp = Amplitude(Vector=evf.Tensor, Amplitude=remap.Mapped)  # disabled

# ----
# Agent System 0.0 with Anemone
polygon = Polygon(Plane=PlaneXY(0, 0, 0), Radius=Slider(29, range=0..100), Segments=Slider(8, range=0..10), FilletRadius=0)  # -> Polygon, Length

# ---- group: boundary
polygon_2 = Polygon(Plane=PlaneXY(0, 0, 0), Radius=Slider(200, range=0..200), Segments=Slider(5, range=0..10), FilletRadius=0)  # -> Polygon, Length
crv = Curve(<curve referenced from the Rhino model>)

# ---- group: vectorField
number_slider_8 = Slider(20, range=0..100)
boundary = BoundarySurfaces(Edges=crv)
number_slider_9 = Slider(5, range=0..10)
sdivide = DivideSurface(Surface=boundary, UCount=number_slider_8, VCount=number_slider_8)  # -> flatten(Points), Normals, Parameters
scale_2 = Scale(Geometry=boundary, Center=Point(0, 0, 0), Factor=Slider(0.7, range=0..1))  # -> Geometry, Transform
random_2 = Random(Range="-4.0 To 4.0", Number=number_slider_9, Seed=2)
popgeo = PopulateGeometry(Geometry=scale_2.Geometry, Count=number_slider_9, Seed=Slider(618, range=0..1000))
clean = CleanTree(RemoveNulls=True, RemoveInvalid=True, RemoveEmpty=False, Tree=sdivide.Points)
fspin_2 = SpinForce(Plane=popgeo, Strength=random_2, Radius=Slider(7.2, range=0..10), Decay=Slider(1, range=0..10))
mergef_2 = MergeFields(Fields=fspin_2)
evf_2 = EvaluateField(Field=mergef_2, Point=clean)  # -> simplify(flatten(Tensor)), Strength
vdis_2 = VectorDisplay(Anchor=clean, Vector=evf_2.Tensor)
bnd_2 = Bounds(Numbers=evf_2.Strength)
remap_2 = RemapNumbers(Value=evf_2.Strength, Source=bnd_2, Target=Domain(0, 1))  # -> Mapped, Clipped
amp_2 = Amplitude(Vector=evf_2.Tensor, Amplitude=remap_2.Mapped)

# ----
disc = Discontinuity(Curve=polygon.Polygon, Level=1)  # -> Points, Parameters
divide = DivideCurve(Curve=polygon.Polygon, Count=Slider(100, range=0..100), Kinks=False)  # -> Points, Tangents, Parameters
reduce = RandomReduce(List=divide.Points, Reduction=Slider(0, range=0..1), Seed=1)
graft = GraftTree(Tree=reduce, IncludeEmptyLists=True, IncludeNullItems=True)  # -> simplify(Tree)

# ---- group: targetSet
# Agent System 2D
number_slider_10 = Slider(51, range=0..100)
divide_2 = DivideCurve(Curve=crv, Count=number_slider_10, Kinks=False)  # -> simplify(flatten(Points)), Tangents, Parameters

# ----
ln = Line(StartPoint=reduce, EndPoint=reduce)
crossref = CrossReference(ListA=flatten(graft), ListB=graft, CrossMode=1)  # -> ListA, ListB
ln_2 = Line(StartPoint=crossref.ListA, EndPoint=crossref.ListB)
# Agent System 3D
brep = Brep(box)  # disabled
vec2pt = Vector2Pt(PointA=crossref.ListA, PointB=crossref.ListB, Unitize=True)  # -> Vector, Length
vdis_3 = VectorDisplay(Anchor=crossref.ListA, Vector=vec2pt.Vector)

# ---- group: targetSet
popgeo_2 = PopulateGeometry(Geometry=brep, Count=100, Seed=1)  # disabled

# ---- group: sourceSet
lng = ListLength(List=divide_2.Points)
multiplication = Multiplication(A=lng, B=Slider(0.29, range=0..0.6))
reduce_2 = RandomReduce(List=divide_2.Points, Reduction=multiplication, Seed=Slider(526, range=0..1000))

number_slider_11 = Slider(0.22, range=0..0.6)  # disabled
lng_2 = ListLength(List=popgeo_2)  # disabled
number_slider_12 = Slider(300, range=0..1000)  # disabled
multiplication_2 = Multiplication(A=lng_2, B=number_slider_11)  # disabled
reduce_3 = RandomReduce(List=popgeo_2, Reduction=multiplication_2, Seed=number_slider_12)  # disabled

# ----
viewer = ParamViewer(graft)
swatch = ColourSwatch(SwatchColor=RGBA(255, 255, 255, 44))  # disabled
split = TextSplit(Text=viewer, Separators="{")
item = ListItem(List=split, Index=0, Wrap=True)  # -> Item, Item1
dup = DuplicateData(Data=graft(reduce), Number=Slider(16, range=2..30), Order=True)
split_2 = TextSplit(Text=item.Item1, Separators="}")
preview = CustomPreview(Geometry=brep, Shader=swatch)  # disabled
preview_2 = CustomPreview(Geometry=popgeo_2, Shader=swatch)  # disabled
item_2 = ListItem(List=split_2, Index=0, Wrap=True)  # -> Item, Item1
cull_i = CullIndex(List=reduce, Indices=item_2.Item, Wrap=True)  # -> simplify(List)
vec2pt_2 = Vector2Pt(PointA=dup, PointB=cull_i, Unitize=True)  # -> Vector, Length
sort = SortList(Keys=vec2pt_2.Length, ValuesA=cull_i, ValuesB=vec2pt_2.Vector)  # -> Keys, ValuesA, ValuesB

# ---- group: steering Set
viasual_angle_degrees = Slider(25, range=0..90)  # disabled
number_slider_13 = Slider(1.1, range=0..10)  # disabled
number_slider_14 = Slider(2.6, range=0..10)  # disabled
number_slider_15 = Slider(0.2, range=0.1..1)  # disabled
panel_4 = Panel([number_slider_13, number_slider_14])  # disabled

# ---- group: mass set
number_slider_16 = Slider(1, range=0..1)  # disabled
number_slider_17 = Slider(5, range=0..10)  # disabled
panel_5 = Panel([number_slider_16, number_slider_17])  # disabled

# ----
item_3 = ListItem(List=sort.ValuesA, Index=0, Wrap=True)  # -> Item1, Item
vec2pt_3 = Vector2Pt(PointA=dup, PointB=item_3.Item1, Unitize=True)  # -> Vector, Length
multiplication_3 = Multiplication(A=vec2pt_3.Vector, B=Slider(0.599, range=0..1))
loop_start = LoopStart(Repeat=Slider(1000, range=0..1000), Trigger=Button(), Data_0=dup, Data_1=multiplication_3)  # -> port, Counter, Data_0, Data_1; disabled

number_slider_18 = Slider(0.8, range=0.1..1)  # disabled

# ---- group: velocity set
number_slider_19 = Slider(0.5, range=0.01..3)  # disabled
mv = Slider(6.39, range=0..8)  # disabled

# ---- group: gravity constant
number_slider_20 = Slider(0.2, range=0..3)  # disabled

# ----
panel_6 = Panel(item_2.Item)

# ---- group: steering Set
viasual_angle_degrees_2 = Slider(25, range=0..90)
number_slider_21 = Slider(0.2, range=0.1..1)
panel_7 = Panel([Slider(1.3, range=0..10), Slider(2.6, range=0..10)])

# ----
vec2pt_4 = Vector2Pt(PointA=loop_start.Data_0, PointB=item_3.Item1, Unitize=True)  # -> Vector, Length
maxspeed = Slider(0.661, range=0..1)

# ---- group: mass set
panel_8 = Panel([Slider(1, range=0..1), Slider(5, range=0..10)])

# ---- group: velocity set
number_slider_22 = Slider(0.5, range=0.01..3)
mv_2 = Slider(6.39, range=0..8)

# ---- group: gravity constant
number_slider_23 = Slider(0.47, range=0..3)

# ----
amp_3 = Amplitude(Vector=vec2pt_4.Vector, Amplitude=maxspeed)
subtraction = Subtraction(A=amp_3, B=loop_start.Data_1)
multiplication_4 = Multiplication(A=subtraction, B=Slider(0.245, range=0..1))
addition = Addition(A=loop_start.Data_1, B=multiplication_4)
amp_4 = Amplitude(Vector=addition, Amplitude=maxspeed)

# ----
# Set to false to stop and reset the simulation
toggle = BooleanToggle(False)

move = Move(Geometry=loop_start.Data_0, Motion=amp_4)  # -> Geometry, Transform
python = PythonScript(
    boundary=crv,
    sourceSet=reduce_2,
    targetSet=divide_2.Points,
    attractionFactor=Slider(0.2, range=0.1..1),
    reset=toggle,
    mass_domain=panel_8,
    mv=number_slider_22,
    Mv=mv_2,
    visual_domain=panel_7,
    visual_angle=viasual_angle_degrees_2,
    steeringFactor=number_slider_21,
    G=number_slider_23,
    field_evaluationPts=clean,
    field_tensorVecs=amp_2)  # -> out, system, a; inputs boundary: Curve, sourceSet: list, targetSet: list of Point3d, mass_domain: list, visual_domain: list, visual_angle: Boolean, field_evaluationPts: list of Point3d, field_tensorVecs: list of Vector3d
# ---------- python: Python ----------
import rhinoscriptsyntax as rs
import Rhino.Geometry as rg
import ghpythonlib.components as gh
import math
import random as rand


class System:
    def __init__ (self, agentList):
        self.agentList = agentList
        
    def update_system(self):
            
        for i in range(len(self.agentList)): 
            agent = self.agentList[i]
            agent.loc_history.append(agent.loc)
            
            #attrazione al target
            distanceVec = rs.VectorCreate(agent.target, agent.loc)
            attraction_force = rs.VectorScale(rs.VectorUnitize(distanceVec), attractionFactor)
            agent.apply_force(attraction_force)
            
            #forza campo vettoriale
            if field_tensorVecs:
                testPt_index = gh.ClosestPoint(agent.loc, field_evaluationPts)[1]
                agent.apply_force(field_tensorVecs[testPt_index])
            
            #campo gravitazionale
            if G and G>0.0:
                for j in range(len(self.agentList)):
                    if i != j:
                        
                        if (rs.VectorSubtract(self.agentList[j].loc, agent.loc) != None):
                            agent.gravitational_behaviour(self.agentList[j])
            
            #neighborhood and steering
            neighboursVec = [0,0,0]
            count = 0
            for j in range(len(self.agentList)):
                if i!=j:
                    isNeighbour = agent.evaluate_neighbours(self.agentList[j])

                    if isNeighbour == True:
                        neighboursVec = rs.VectorAdd(neighboursVec, self.agentList[j].vel)
                        #neighboursVecList.append(self.agentList[j].vel)
                        count+=1
                        
                        #print rs.VectorAdd(neighboursVec, self.agentList[j].vel)
                        #count+=1
                        #neighboursVec = rs.VectorAdd(neighboursVec, self.agentList[j].vel)
            if count > 0:
                m_neighboursVec = rs.VectorDivide(neighboursVec, count)
                steeringVec = rs.VectorSubtract(m_neighboursVec, agent.vel)
                steeringForce =  rs.VectorScale(steeringVec, steeringFactor)
                agent.apply_force(steeringForce)
                """
                a = rs.VectorDivide(neighboursVec, count)
                scale_factor = rs.VectorLength(rs.VectorDivide(neighboursVec, count))
                if scale_factor > Mv:
                    scale_factor = Mv
                #neighboursVec = rs.VectorUnitize(neighboursVec)
                neighboursVec = rs.VectorScale(rs.VectorUnitize(neighboursVec), scale_factor)
                #print neighboursVec
                #lenght = rs.VectorLength(neighboursVec)/count
                #print 
                #neighboursVec = rs.VectorDivide(neighboursVec, count)
                steeringForce =  rs.VectorSubtract(neighboursVec, agent.vel)
                agent.apply_force(steeringForce)
                """
            agent.update_loc()
            agent.check_loc()
    

class Agent:
    def __init__(self, loc, mass, vel, acc, source_index):
        self.loc = loc
        self.vel = vel
        self.acc = acc
        self.source_index = source_index
        self.loc_history = []
        self.target = [0,0,0]
        self.mass = mass
        
        
    def find_target(self, targetSet):
        distances = []
        for i in range(len(targetSet)):
            target = rs.coerce3dpoint(targetSet[i])
            dist = rs.VectorLength(rs.VectorCreate(target, self.loc))
            distances.append(dist)
        
        distances, targetSet = zip(*sorted(zip(distances, targetSet)))
        return targetSet[-1]
        
    def update_loc(self):
        vel = rs.VectorAdd(self.vel, self.acc)
        if rs.VectorLength(vel) > Mv:
            self.vel = rs.VectorScale(rs.VectorUnitize(self.vel), Mv)
        elif not vel:
            print "yes"
            self.vel = rs.VectorScale(rs.VectorUnitize(self.vel), Mv)
        else:
            self.vel = vel
        self.loc = rs.VectorAdd(self.loc, self.vel)
        self.acc = [0,0,0]
        
    def check_loc(self):
        if (rs.PointInPlanarClosedCurve(self.loc, boundary)!=1):
            t_closestPt = rs.CurveClosestPoint(boundary, self.loc)
            closestPt = rs.EvaluateCurve(boundary, t_closestPt)
            if closestPt:
                self.loc = closestPt
                self.target = self.find_target(targetSet)
            self.vel = rs.VectorScale(rs.VectorUnitize(rs.VectorCreate(self.target, self.loc)), mv)
            self.acc = [0,0,0]
    
    def evaluate_neighbours(self, otherAgent):
        isNeighbour = False
        vec = rs.VectorCreate(otherAgent.loc, self.loc)
        #print rs.VectorLength(vec)
        if (rs.VectorLength(vec) > visual_domain[0] and rs.VectorLength(vec) < visual_domain[1]):
            if (rs.VectorLength(vec) > 0):
                if (rs.VectorAngle(self.vel, vec) < visual_angle):
                    #print "yes"
                    isNeighbour = True
        return isNeighbour
    
    def apply_force(self, force):
        #acc = f/m > f (vec) scale by 1/m
        
        thisAcc = rs.VectorScale(force, (1/self.mass))
        self.acc = rs.VectorAdd(thisAcc, self.acc)
    
    def gravitational_behaviour(self, otherAgent):
        #Apply a gravitational force to this agent that moves it toward the agent you pass in

        G = 1

        rVec = rs.VectorSubtract(otherAgent.loc, self.loc)
        rDist = rs.VectorLength(rVec)

        if (rDist < 1) : 
            rDist = 1
        elif (rDist > 15):
            rDist = 15
            
        rUnitVec = rs.VectorUnitize(rVec)
        #magnitude = (G)/(rDist*rDist)
        magnitude = (G*self.mass*otherAgent.mass)/(rDist*rDist)
        
        if rs.VectorLength(rVec) > 0:
            forceGrav = rs.VectorScale(rUnitVec, magnitude)
        
            self.apply_force(forceGrav)
        """
        if (rVec[0] < 1000000 and rVec [0]> -100000000):
            #print rVec
            if (rDist < 1) : 
                rDist = 1
            rUnitVec = rs.VectorUnitize(rVec)
        
            #magnitude = (G)/(rDist*rDist)
            magnitude = (G*self.mass*otherAgent.mass)/(rDist*rDist)
            
            forceGrav = rs.VectorScale(rUnitVec, magnitude)
            
            self.apply_force(forceGrav)
            """
        

agentList = []
for i in range(len(sourceSet)):
    loc = rs.coerce3dpoint(sourceSet[i])
    vel = [0, 0, 0]
    acc = [0, 0, 0]
    mass = rand.uniform(mass_domain[0], mass_domain[1])
    agent = Agent(rs.coerce3dpoint(sourceSet[i]), mass, vel, acc, i)
    agent.target = agent.find_target(targetSet)
    agent.vel = rs.VectorScale(rs.VectorUnitize(rs.VectorCreate(agent.target, agent.loc)), mv)
    agentList.Add(agent)

if reset:
    system = System(agentList)
# ---------- end python ----------
timer = Timer(TimerInterval=20, Target=python_2)  # disabled

# ----
# Set to false to stop and reset the simulation
toggle_2 = BooleanToggle(False)  # disabled

running = Running(port=loop_start.port, Exit=False, Data_0=move.Geometry, Data_1=amp_4, pausedState=False, state="Constant output")  # -> simplify(Data_0), Data_1

# ----
# set to False to stop the simulation
toggle_3 = BooleanToggle(False)

vec = Vector(python.a)
flip = FlipMatrix(Data=running.Data_0)
python_2 = PythonScript(enableProcess=toggle_3, system=python.system)  # -> out, a
# ---------- python_2: Python ----------
if enableProcess == True:

    system.update_system()


a = system.agentList
# ---------- end python_2 ----------
python_3 = PythonScript(
    boundary=brep,
    boundaryBounds=number_slider,
    sourceSet=reduce_3,
    targetSet=popgeo_2,
    attractionFactor=number_slider_18,
    reset=toggle_2,
    mass_domain=panel_5,
    mv=number_slider_19,
    Mv=mv,
    visual_domain=panel_4,
    visual_angle=viasual_angle_degrees,
    steeringFactor=number_slider_15,
    G=number_slider_20,
    field_evaluationPts=evf.Tensor,
    field_tensorVecs=amp)  # -> out, system; inputs boundary: Brep, sourceSet: list, targetSet: list of Point3d, mass_domain: list, visual_domain: list, visual_angle: Boolean, field_evaluationPts: list of Point3d, field_tensorVecs: list of Vector3d; disabled
# ---------- python_3: Python ----------
import rhinoscriptsyntax as rs
import Rhino.Geometry as rg
import ghpythonlib.components as gh
import math
import random as rand


class System:
    def __init__ (self, agentList):
        self.agentList = agentList
        
    def update_system(self):
            
        for i in range(len(self.agentList)): 
            agent = self.agentList[i]
            agent.loc_history.append(agent.loc)
            
            #attrazione al target
            distanceVec = rs.VectorCreate(agent.target, agent.loc)
            attraction_force = rs.VectorScale(rs.VectorUnitize(distanceVec), attractionFactor)
            agent.apply_force(attraction_force)
            
            #forza campo vettoriale
            if field_tensorVecs:
                testPt_index = gh.ClosestPoint(agent.loc, field_evaluationPts)[1]
                agent.apply_force(field_tensorVecs[testPt_index])
            
            #campo gravitazionale
            if G and G>0.0:
                for j in range(len(self.agentList)):
                    if i != j:
                        
                        if (rs.VectorSubtract(self.agentList[j].loc, agent.loc) != None):
                            agent.gravitational_behaviour(self.agentList[j])
            
            #neighborhood and steering
            neighboursVec = [0,0,0]
            count = 0
            for j in range(len(self.agentList)):
                if i!=j:
                    isNeighbour = agent.evaluate_neighbours(self.agentList[j])

                    if isNeighbour == True:
                        neighboursVec = rs.VectorAdd(neighboursVec, self.agentList[j].vel)
                        #neighboursVecList.append(self.agentList[j].vel)
                        count+=1
                        
                        #print rs.VectorAdd(neighboursVec, self.agentList[j].vel)
                        #count+=1
                        #neighboursVec = rs.VectorAdd(neighboursVec, self.agentList[j].vel)
            if count > 0:
                m_neighboursVec = rs.VectorDivide(neighboursVec, count)
                steeringVec = rs.VectorSubtract(m_neighboursVec, agent.vel)
                steeringForce =  rs.VectorScale(steeringVec, steeringFactor)
                agent.apply_force(steeringForce)
                """
                a = rs.VectorDivide(neighboursVec, count)
                scale_factor = rs.VectorLength(rs.VectorDivide(neighboursVec, count))
                if scale_factor > Mv:
                    scale_factor = Mv
                #neighboursVec = rs.VectorUnitize(neighboursVec)
                neighboursVec = rs.VectorScale(rs.VectorUnitize(neighboursVec), scale_factor)
                #print neighboursVec
                #lenght = rs.VectorLength(neighboursVec)/count
                #print 
                #neighboursVec = rs.VectorDivide(neighboursVec, count)
                steeringForce =  rs.VectorSubtract(neighboursVec, agent.vel)
                agent.apply_force(steeringForce)
                """
            agent.update_loc()
            agent.check_loc()
    

class Agent:
    def __init__(self, loc, mass, vel, acc, source_index):
        self.loc = loc
        self.vel = vel
        self.acc = acc
        self.source_index = source_index
        self.loc_history = []
        self.target = [0,0,0]
        self.mass = mass
        
        
    def find_target(self, targetSet):
        distances = []
        for i in range(len(targetSet)):
            target = rs.coerce3dpoint(targetSet[i])
            dist = rs.VectorLength(rs.VectorCreate(target, self.loc))
            distances.append(dist)
        
        distances, targetSet = zip(*sorted(zip(distances, targetSet)))
        return targetSet[-1]
        
    def update_loc(self):
        vel = rs.VectorAdd(self.vel, self.acc)
        if rs.VectorLength(vel) > Mv:
            self.vel = rs.VectorScale(rs.VectorUnitize(self.vel), Mv)
        elif not vel:
            print "yes"
            self.vel = rs.VectorScale(rs.VectorUnitize(self.vel), Mv)
        else:
            self.vel = vel
        self.loc = rs.VectorAdd(self.loc, self.vel)
        self.acc = [0,0,0]
        
    def check_loc(self):
        if (self.loc[0]>= boundaryBounds and self.loc[1]>= boundaryBounds and self.loc[2]>= boundaryBounds):
        #if (gh.PointInBrep(boundary, self.loc, True)==False):
        #if (rs.PointInPlanarClosedCurve(self.loc, boundary)!=1):
            #t_closestPt = rs.BrepClosestPoint(boundary, self.loc)
            closestPt = rs.BrepClosestPoint(boundary, self.loc)[0]
            #rs.CurveClosestPoint(boundary, self.loc)
            #closestPt = rs.EvaluateCurve(boundary, t_closestPt)
            if closestPt:
                self.loc = closestPt
                self.target = self.find_target(targetSet)
            self.vel = rs.VectorScale(rs.VectorUnitize(rs.VectorCreate(self.target, self.loc)), mv)
            self.acc = [0,0,0]
        
        
        
        """
        if (rs.PointInPlanarClosedCurve(self.loc, boundary)!=1):
            t_closestPt = rs.CurveClosestPoint(boundary, self.loc)
            closestPt = rs.EvaluateCurve(boundary, t_closestPt)
            if closestPt:
                self.loc = closestPt
                self.target = self.find_target(targetSet)
            self.vel = rs.VectorScale(rs.VectorUnitize(rs.VectorCreate(self.target, self.loc)), mv)
            self.acc = [0,0,0]
            """
    
    def evaluate_neighbours(self, otherAgent):
        isNeighbour = False
        vec = rs.VectorCreate(otherAgent.loc, self.loc)
        #print rs.VectorLength(vec)
        if (rs.VectorLength(vec) > visual_domain[0] and rs.VectorLength(vec) < visual_domain[1]):
            if (rs.VectorLength(vec) > 0):
                if (rs.VectorAngle(self.vel, vec) < visual_angle):
                    #print "yes"
                    isNeighbour = True
        return isNeighbour
    
    def apply_force(self, force):
        #acc = f/m > f (vec) scale by 1/m
        
        thisAcc = rs.VectorScale(force, (1/self.mass))
        self.acc = rs.VectorAdd(thisAcc, self.acc)
    
    def gravitational_behaviour(self, otherAgent):
        #Apply a gravitational force to this agent that moves it toward the agent you pass in

        G = 1

        rVec = rs.VectorSubtract(otherAgent.loc, self.loc)
        rDist = rs.VectorLength(rVec)

        if (rDist < 1) : 
            rDist = 1
        elif (rDist > 15):
            rDist = 15
            
        rUnitVec = rs.VectorUnitize(rVec)
        #magnitude = (G)/(rDist*rDist)
        magnitude = (G*self.mass*otherAgent.mass)/(rDist*rDist)
        
        if rs.VectorLength(rVec) > 0:
            forceGrav = rs.VectorScale(rUnitVec, magnitude)
        
            self.apply_force(forceGrav)
        """
        if (rVec[0] < 1000000 and rVec [0]> -100000000):
            #print rVec
            if (rDist < 1) : 
                rDist = 1
            rUnitVec = rs.VectorUnitize(rVec)
        
            #magnitude = (G)/(rDist*rDist)
            magnitude = (G*self.mass*otherAgent.mass)/(rDist*rDist)
            
            forceGrav = rs.VectorScale(rUnitVec, magnitude)
            
            self.apply_force(forceGrav)
            """
        

agentList = []
for i in range(len(sourceSet)):
    loc = rs.coerce3dpoint(sourceSet[i])
    vel = [0, 0, 0]
    acc = [0, 0, 0]
    mass = rand.uniform(mass_domain[0], mass_domain[1])
    agent = Agent(rs.coerce3dpoint(sourceSet[i]), mass, vel, acc, i)
    agent.target = agent.find_target(targetSet)
    agent.vel = rs.VectorScale(rs.VectorUnitize(rs.VectorCreate(agent.target, agent.loc)), mv)
    agentList.Add(agent)

if reset:
    system = System(agentList)
# ---------- end python_3 ----------
panel_9 = Panel(python_2.out)
pline = PolyLine(Vertices=flip, Closed=False)
timer_2 = Timer(TimerInterval=20, Target=python_6)  # disabled
python_4 = PythonScript(agentList=python_2.a)  # -> out, graft(agentHistoryLocationList); inputs agentList: list
# ---------- python_4: Python ----------
import rhinoscriptsyntax as rs
import Rhino.Geometry as rg
import ghpythonlib.components as gh
import math
import random as rand

agentHistoryLocList =[]
for i in range(len(agentList)):
    agentHistoryLocList.append(agentList[i].loc_history)

    

agentHistoryLocationList = agentHistoryLocList
# ---------- end python_4 ----------

# ----
# set to False to stop the simulation
toggle_4 = BooleanToggle(True)  # disabled

python_5 = PythonScript(agentList=python_2.a)  # -> out, agentLocationList; inputs agentList: list
# ---------- python_5: Python ----------
import rhinoscriptsyntax as rs
import Rhino.Geometry as rg
import ghpythonlib.components as gh
import math
import random as rand

agentVisualizationList =[]
"""
for i in range(len(agentList)):
    loc = agentList[i].loc
    mass = agentList[i].mass
    sphere = rs.AddSphere(loc, mass)
    agentVisualizationList.append(sphere)
"""    
for i in range(len(agentList)):
    loc = agentList[i].loc

    agentVisualizationList.append(loc)
    
agentLocationList = agentVisualizationList
# ---------- end python_5 ----------
python_6 = PythonScript(enableProcess=toggle_4, system=python_3.system)  # -> out, a; disabled; same code as python_2
pt_3 = Point(python_5.agentLocationList)
pylist = PythonScript(x=python_4.agentHistoryLocationList)  # -> out, simplify(a)
# ---------- pylist: Python ----------
import collections
xIsAList = isinstance(x, collections.Iterable)

if (xIsAList):
    a = x
else:
    a = [x]
# ---------- end pylist ----------
dam = DataDam(DataA=python_4.agentHistoryLocationList, BufferDelay=10000000, BufferMode=0)
python_7 = PythonScript(agentList=python_6.a)  # -> out, agentLocationList; inputs agentList: list; disabled
# ---------- python_7: Python ----------
import rhinoscriptsyntax as rs
import Rhino.Geometry as rg
import ghpythonlib.components as gh
import math
import random as rand

agentLocList =[]
for i in range(len(agentList)):

    agentLocList.append(agentList[i].loc)
    

agentLocationList = agentLocList
# ---------- end python_7 ----------
python_8 = PythonScript(agentList=python_6.a)  # -> out, simplify(graft(agentHistoryLocationList)); inputs agentList: list; disabled; same code as python_4
pline_2 = PolyLine(Vertices=pylist.a, Closed=False)
pt_4 = Point(python_7.agentLocationList)  # disabled
pylist_2 = PythonScript(x=python_8.agentHistoryLocationList)  # -> out, simplify(a); disabled; same code as pylist
pline_3 = PolyLine(Vertices=pylist_2.a, Closed=False)  # disabled
