# Grasshopper definition SoA_canopy.gh (Grasshopper 0.9.76)
# Copyright: 2014
# plug-ins: Python Interpreter, Anemone, Boid

pt = Point(<point referenced from the Rhino model>)
number_slider = Slider(35, range=0..60)
sph = Sphere(Base=pt, Radius=0.1)
pop3d = Populate3D(Region=sph, Count=number_slider, Seed=1)
rndvec = RandomVector(Number=number_slider, Unit=False, RandomSeed=2, AbsoluteMultiplier=1)

start = Button()
force_exit = BooleanToggle(True)
geo = Geometry(<mesh referenced from the Rhino model>)
agent_status = Panel("""0 = not arrived
1 = arrived""")

# ----
# sift-combine
series = Series(Start=0, Step=1, Count=10)
sift = SiftPattern(List=series, SiftPattern=[0, 0, 1, 1])  # -> Output0, Output1
multiplication = Multiplication(A=sift.Output1, B=2)
panel = Panel(sift.Output0)
panel_2 = Panel(multiplication)
combine = CombineData(Input0=sift.Output0, Input1=multiplication)  # -> Result, Index
panel_3 = Panel(combine.Result)

number_slider_2 = Slider(-100, range=-100..0)
Y = UnitY(Factor=number_slider_2)
number_slider_3 = Slider(40, range=1..100)
Y_2 = UnitY(Factor=number_slider_2)

# ----
# expanded upon a BOID library tutorial
# 
# BOID library by Jan Pernecky
# 
# grasshopper.rese-arch.org
pt_2 = Point(<point referenced from the Rhino model>)
number_slider_4 = Slider(15, range=0..60)
rndvec_2 = RandomVector(Number=number_slider_4, Unit=False, RandomSeed=2, AbsoluteMultiplier=1)

sph_2 = Sphere(Base=pt_2, Radius=0.1)

pop3d_2 = Populate3D(Region=sph_2, Count=number_slider_4, Seed=1)

entwine = Entwine(Branch00=pop3d_2, Branch01=pop3d, FlattenInputs=True)
entwine_2 = Entwine(Branch00=pt, Branch01=pt_2, FlattenInputs=True)

lng = ListLength(List=entwine)
dup = DuplicateData(Data="0", Number=lng, Order=True)

entwine_3 = Entwine(Branch00=rndvec_2, Branch01=rndvec, FlattenInputs=True)

loop_start = LoopStart(N=Slider(500, range=0..10000), T=start, D0=entwine, D1=entwine_3, D2=dup)  # -> port, Counter, Data, Data_2, Data_3

panel_4 = Panel(loop_start.Counter)
sift_2 = SiftPattern(List=loop_start.Data, SiftPattern=loop_start.Data_3)  # -> Output0, Output1
sift_3 = SiftPattern(List=loop_start.Data_2, SiftPattern=loop_start.Data_3)  # -> Output0, Output1
sift_4 = SiftPattern(List=loop_start.Data_3, SiftPattern=loop_start.Data_3)  # -> Output0, Output1

meshcp = MeshClosestPoint(Point=sift_2.Output0, Mesh=geo)  # -> Point, Index, Parameter
vec2pt = Vector2Pt(PointA=sift_2.Output0, PointB=meshcp.Point, Unitize=False)  # -> Vector, Length
pi = Pi(Factor=Slider(0.5, range=0..1))
geo_2 = Geometry(<curve referenced from the Rhino model>)
vrot = Rotate(Vector=vec2pt.Vector, Axis=geo_2, Angle=pi)
multiplication_2 = Multiplication(A=vrot, B=Slider(0.8, range=0..1))
# twister
python = PythonScript(vel=multiplication_2, status=loop_start.Data_3, target=entwine_2)  # -> out, a; inputs vel: Vector3d, status: Int32, target: Point3d
# ---------- python: Python ----------
import math
import rhinoscriptsyntax as rs

if target==rs.coerce3dpoint([-15,0,0]):
    a = rs.coerce3dvector(vel)*1
else:
    a = rs.coerce3dvector(vel)*0
# ---------- end python ----------

# ----
# exit condition: exit if all agents have reached their target
clean = CleanTree(RemoveNulls=True, RemoveInvalid=True, RemoveEmpty=False, Tree=sift_2.Output1)
lng_2 = ListLength(List=flatten(clean))
lng_3 = ListLength(List=flatten(entwine))
equals = Equality(FirstNumber=lng_2, SecondNumber=lng_3)  # -> Equality, Inequality

bang = ExplodeTree(Data=sift_2.Output0)  # -> Branch0, Branch1
entwine_4 = Entwine(Branch00=bang.Branch1, Branch01=bang.Branch0, FlattenInputs=True)
dom = ConstructDomain(DomainStart=Slider(0.077, range=0..1), DomainEnd=Slider(3.984, range=0..10))
# repulse other flock
repulse = RepulseFromTheFlock(
    AgentLocationPoint=sift_2.Output0,
    LocationPointsOfTheFlock=entwine_4,
    SearchDistance=dom,
    Multiplier=Slider(0.3, range=0..1))

dom_2 = ConstructDomain(DomainStart=Slider(0.077, range=0..1), DomainEnd=Slider(0.272, range=0..10))
# stick & slide on geometry + flock cohesion
# repulse own flock
# (a.k.a. "don't stand so close to me")
repulse_2 = RepulseFromTheFlock(
    AgentLocationPoint=sift_2.Output0,
    LocationPointsOfTheFlock=sift_2.Output0,
    SearchDistance=dom_2,
    Multiplier=Slider(0.5, range=0..1))

# ----
# check arrival (Python)
python_2 = PythonScript(oldPos=sift_2.Output0, status=loop_start.Data_3, target=entwine_2, thres=Slider(1.452, range=0..5))  # -> out, a; inputs oldPos: Point3d, status: Int32, target: Point3d
# ---------- python_2: Python ----------
import math
import rhinoscriptsyntax as rs

if status == 0:
    if rs.Distance(oldPos,target)<thres:
        a=1
    else:
        a=0
else:
    a=status

#a = points
#a = rs.coerce3dpointlist(target_1)
# ---------- end python_2 ----------

adhere = AhereToTheFlockCenter(
    AgentLocationPoint=sift_2.Output0,
    LocationPointsOfTheFlock=entwine_2,
    SearchDistance=Domain(0, 0),
    ReferenceAgentsCount=-1,
    Multiplier=0.1)
stick = StickToGeometry(
    AgentLocationPoint=sift_2.Output0,
    ReferenceGeometry=geo,
    SearchDistance=Domain(0, 0),
    Multiplier=Slider(0.084, range=0..1))
slide = SlideOverGeometry(
    AgentLocationPoint=sift_2.Output0,
    AgentMotionVector=adhere,
    ReferenceGeometry=geo,
    SearchDistance=Domain(0, 0),
    Multiplier=Slider(1, range=0..1))

python_3 = PythonScript(oldPos=sift_2.Output0, status=loop_start.Data_3, target=entwine_2)  # -> out, a; disabled
# ---------- python_3: Python ----------
import math
import rhinoscriptsyntax as rs

points = []
dist = []
for i in oldPos:
    #points.append(i)
    data = [rs.coerce3dpoint(i)]
    points.append(data)
    print points
    
    
print len(points)
for i in range(len(oldPos)):
    if i <= agents_1:
        dist.append(rs.Distance(points[i]-[15,0,0]))
    else:
        dist.append(rs.Distance(abs(points(i)-target_2())))

a = points
#a = rs.coerce3dpointlist(target_1)
# ---------- end python_3 ----------
or = GateOr(A=equals.Equality, B=force_exit)

threshold = Slider(0.3, range=0..5)
dist = Distance(PointA=sift_2.Output0, PointB=entwine_2)
smaller = SmallerThan(FirstNumber=dist, SecondNumber=threshold)  # -> SmallerThan, OrEqualTo
sift_5 = SiftPattern(List=sift_4.Output0, SiftPattern=smaller.SmallerThan)  # -> Output0, Output1
addition = Addition(A=sift_5.Output1, B="1")
# check arrival
# (standard components)
combine_2 = CombineData(Input0=sift_5.Output0, Input1=addition)  # -> Result, Index

addition_2 = Addition(A=stick, B=slide, C=sift_3.Output0)
# build acceleration
addition_3 = Addition(A=stick, B=slide, C=repulse_2, D=repulse, E=python.a)

# ----
# add to speed and limit
speed_limit = Slider(0.15, range=0..1)
addition_4 = Addition(A=sift_3.Output0, B=addition_3)
amp = Amplitude(Vector=addition_4, Amplitude=speed_limit)

move = Move(Geometry=sift_2.Output0, Motion=amp)  # -> Geometry, Transform
combine_3 = CombineData(Input0=amp, Input1=addition_2)  # -> Result, Index
combine_4 = CombineData(Input0=combine_2.Result, Input1=sift_4.Output1)  # -> Result, Index
combine_5 = CombineData(Input0=move.Geometry, Input1=sift_2.Output1)  # -> Result, Index
combine_6 = CombineData(Input0=amp, Input1=sift_3.Output1)  # -> Result, Index; disabled

loop_end = LoopEnd(
    port=loop_start.port,
    Exit=or,
    Data=combine_5.Result,
    Data_2=combine_3.Result,
    Data_3=combine_4.Result,
    pausedState=False,
    state="Constant & Record",
    TimeOutVal=0)  # -> simplify(D0), D1, D2

pt_3 = Point(loop_end.D0)
viewer = ParamViewer(pt_3)
dispatch = Dispatch(List=viewer, DispatchPattern=[True, False])  # -> ListA, ListB
panel_5 = Panel(dispatch.ListB)
branch = TreeBranch(Tree=pt_3, Path=dispatch.ListB, MaintainPaths=True)
branch_2 = TreeBranch(Tree=pt_3, Path=dispatch.ListA, MaintainPaths=True)
flip = FlipMatrix(Data=branch_2)
flip_2 = FlipMatrix(Data=branch)
meshcp_2 = MeshClosestPoint(Point=flip, Mesh=geo)  # -> Point, Index, Parameter
meshcp_3 = MeshClosestPoint(Point=flip_2, Mesh=geo)  # -> Point, Index, Parameter
cull = CullPattern(List=meshcp_3.Point, CullPattern="1")
cull_2 = CullPattern(List=meshcp_2.Point, CullPattern="1")
pline = PolyLine(Vertices=cull, Closed=False)
pline_2 = PolyLine(Vertices=cull_2, Closed=False)
crv = Curve([pline_2, pline])
preview = CustomPreview(Geometry=pline, Shader=ColourSwatch(SwatchColor=RGB(33, 207, 45)))
preview_2 = CustomPreview(Geometry=pline_2, Shader=ColourSwatch(SwatchColor=RGB(33, 30, 30)))
move_2 = Move(Geometry=pline_2, Motion=Y_2)  # -> Geometry, Transform
move_3 = Move(Geometry=pline, Motion=Y)  # -> Geometry, Transform
