# Grasshopper definition esempio15.gh (Grasshopper 0.9.76)
# Copyright: 2014
# plug-ins: Anemone, Boid

pt = Point(<point referenced from the Rhino model>)
pt_2 = Point(<point referenced from the Rhino model>)

# ---- group: ANEMONE / SET TO A LARGE VALUE
# the BOID Library
# grasshopper.rese-arch.org
# TUTORIAL FILE
# Follow the examples from top to bottom. Each example need to be enabled and the Anemone N slider set to maximum.
# Basic setup
number_slider = Slider(2214, range=0..10000)

# ----
sph = Sphere(Base=pt, Radius=0.1)

number_slider_2 = Slider(12, range=0..1000)
pop3d = Populate3D(Region=sph, Count=number_slider_2, Seed=1)
rndvec = RandomVector(Number=number_slider_2, Unit=False, RandomSeed=2, AbsoluteMultiplier=1)

button = Button()
sph_2 = Sphere(Base=pt_2, Radius=0.1)

number_slider_3 = Slider(0, range=0..1000)
pop3d_2 = Populate3D(Region=sph_2, Count=number_slider_3, Seed=1)

button_2 = Button()

rndvec_2 = RandomVector(Number=number_slider_3, Unit=False, RandomSeed=2, AbsoluteMultiplier=1)

geo = Geometry(<mesh referenced from the Rhino model>)
entwine = Entwine(Branch00=rndvec_2, Branch01=rndvec, FlattenInputs=True)
entwine_2 = Entwine(Branch00=pop3d_2, Branch01=pop3d, FlattenInputs=True)
entwine_3 = Entwine(Branch00=pt, Branch01=pt_2, FlattenInputs=True)
# Random wander
number_slider_4 = Slider(0.339, range=0..1)
# Chase bait
# Inertia and friction
panel = Panel("0.5")
dom = ConstructDomain(DomainStart=Slider(0.077, range=0..1), DomainEnd=Slider(1.36, range=0..10))
dom_2 = ConstructDomain(DomainStart=Slider(0.077, range=0..1), DomainEnd=Slider(0.272, range=0..10))
dom_3 = ConstructDomain(DomainStart=Slider(0.101, range=0..1), DomainEnd=Slider(3.984, range=0..10))
pi = Pi(Factor=panel)
# Trim vector
# Separation
# Adhesion
# Alignment
# Visibility
# Planarization
# Slide
# Stick
# Revolve
# Bounce
number_slider_5 = Slider(1, range=0..1)
toggle = BooleanToggle(False)

# ---- group: ANEMONE
# by Jan Pernecky
loop_start = LoopStart(Repeat=number_slider, Trigger=button_2, Data_0=pop3d_2, Data_1=rndvec_2)  # -> port, Counter, Data_0, Data_1; disabled

# ----
repulse = RepulseFromTheFlock(
    AgentLocationPoint=loop_start.Data_0,
    LocationPointsOfTheFlock=loop_start.Data_0,
    SearchDistance=dom,
    Multiplier=Slider(0.399, range=0..1))

loop_start_2 = LoopStart(Repeat=Slider(257, range=0..10000), Trigger=button_2, Data_0=entwine_2, Data_1=entwine)  # -> port, Counter, Data_0, Data_1

bang = ExplodeTree(Data=loop_start_2.Data_0)  # -> Branch0, Branch1
meshcp = MeshClosestPoint(Point=loop_start_2.Data_0, Mesh=geo)  # -> Point, Index, Parameter
entwine_4 = Entwine(Branch00=bang.Branch1, Branch01=bang.Branch0, FlattenInputs=True)
adhere = AhereToTheFlockCenter(
    AgentLocationPoint=loop_start_2.Data_0,
    LocationPointsOfTheFlock=entwine_3,
    SearchDistance=Domain(0, 0),
    ReferenceAgentsCount=-1,
    Multiplier=0.1)
vec2pt = Vector2Pt(PointA=loop_start_2.Data_0, PointB=meshcp.Point, Unitize=False)  # -> Vector, Length
repulse_2 = RepulseFromTheFlock(
    AgentLocationPoint=loop_start_2.Data_0,
    LocationPointsOfTheFlock=entwine_4,
    SearchDistance=dom_3,
    Multiplier=number_slider_4)
stick = StickToGeometry(
    AgentLocationPoint=loop_start_2.Data_0,
    ReferenceGeometry=geo,
    SearchDistance=Domain(0, 0),
    Multiplier=Slider(0.084, range=0..1))
repulse_3 = RepulseFromTheFlock(
    AgentLocationPoint=loop_start_2.Data_0,
    LocationPointsOfTheFlock=loop_start_2.Data_0,
    SearchDistance=dom_2,
    Multiplier=Slider(0.339, range=0..1))
slide = SlideOverGeometry(
    AgentLocationPoint=loop_start_2.Data_0,
    AgentMotionVector=adhere,
    ReferenceGeometry=geo,
    SearchDistance=Domain(0, 0),
    Multiplier=Slider(1, range=0..1))
dist = Distance(PointA=loop_start_2.Data_0, PointB=entwine_3)
vrot = Rotate(Vector=vec2pt.Vector, Axis=loop_start_2.Data_1, Angle=pi)
multiplication = Multiplication(A=vrot, B=number_slider_5)
addition = Addition(A=stick, B=slide, C=repulse_3, D=repulse_2, E=multiplication)
eval = Evaluate(F="x<y", x=dist, y=Slider(0.25, range=0..1))
addition_2 = Addition(A=loop_start_2.Data_1, B=addition)
panel_2 = Panel(eval)
multiplication_2 = Multiplication(A=repulse_3, B=eval)
amp = Amplitude(Vector=addition_2, Amplitude=Slider(0.193, range=0..1))

move = Move(Geometry=loop_start_2.Data_0, Motion=amp)  # -> Geometry, Transform
loop_end = LoopEnd(port=loop_start_2.port, Exit=toggle, Data_0=move.Geometry, Data_1=amp, pausedState=False, state="Constant & Record")  # -> simplify(Data_0), Data_1

panel_3 = Panel(multiplication_2)
pt_3 = Point(simplify(loop_end.Data_0))
viewer = ParamViewer(pt_3)
dispatch = Dispatch(List=viewer, DispatchPattern=[True, False])  # -> ListA, ListB
panel_4 = Panel(dispatch.ListB)
branch = TreeBranch(Tree=pt_3, Path=dispatch.ListB, MaintainPaths=True)
branch_2 = TreeBranch(Tree=pt_3, Path=dispatch.ListA, MaintainPaths=True)
flip = FlipMatrix(Data=branch_2)

flip_2 = FlipMatrix(Data=loop_end.Data_0)  # disabled
pline = PolyLine(Vertices=flip, Closed=False)

flip_3 = FlipMatrix(Data=branch)
pline_2 = PolyLine(Vertices=flip_3, Closed=False)
preview = CustomPreview(Geometry=pline_2, Shader=ColourSwatch(SwatchColor=RGB(0, 0, 0)))
preview_2 = CustomPreview(Geometry=pline, Shader=ColourSwatch(SwatchColor=RGB(255, 255, 255)))

adhere_2 = AhereToTheFlockCenter(
    AgentLocationPoint=loop_start.Data_0,
    LocationPointsOfTheFlock=pt,
    SearchDistance=Domain(0, 0),
    ReferenceAgentsCount=-1,
    Multiplier=0.1)
geo_2 = Geometry(<mesh referenced from the Rhino model>)
slide_2 = SlideOverGeometry(
    AgentLocationPoint=loop_start.Data_0,
    AgentMotionVector=adhere_2,
    ReferenceGeometry=geo_2,
    SearchDistance=Domain(0, 0),
    Multiplier=Slider(1, range=0..1))
multiplication_3 = Multiplication(A=slide_2, B=Slider(0.102, range=0..1))

addition_3 = Addition(A=slide_2, B=repulse)
amp_2 = Amplitude(Vector=addition_3, Amplitude=Slider(0.077, range=0..1))

move_2 = Move(Geometry=loop_start.Data_0, Motion=amp_2)  # -> Geometry, Transform

# ---- group: ANEMONE (continued)
loop_end_2 = LoopEnd(
    port=loop_start.port,
    Exit=toggle,
    Data_0=flatten(move_2.Geometry),
    Data_1=flatten(amp_2),
    pausedState=False,
    state="Constant & Record")  # -> simplify(Data_0), Data_1

# ----
flip_4 = FlipMatrix(Data=loop_end_2.Data_0)
pline_3 = PolyLine(Vertices=flip_4, Closed=False)
